# Grasshopper definition 20210506_Salad_Robot_components.gh (Grasshopper 1.0.7)
# plug-ins: RobotComponents.Gh, Salad Slicer

number_slider = Slider(10000, range=0..100000)
F = SetFeedrate(Feedrate=number_slider)
cl = CodeLine(Code="; Print something")
series = Series(Start=0, Step=Slider(9.25, range=0..10), Count=Slider(100, range=0..100))
crv = Curve(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)
planar_2_5d_slicer = Planar25DSlicer(
    Curve=crv,
    Parameter=Slider(0.093, range=0..1),
    Length=Slider(230, range=0..1000),
    Distance=Slider(25, range=0..100),
    Heights=series)
merge = Merge(Data1=flatten(cl), Data2=flatten(F), Data3=flatten(planar_2_5d_slicer))  # -> flatten(Result)
pg = ProgramGenerator(ProgramObjectsLines=merge)
dpo = DeconstructProgramObject(ProgramObject=planar_2_5d_slicer)  # -> Path, Planes, StartPlane, EndPlane
crv_2 = Curve(dpo.Path)
pt = Point(dpo.StartPlane)
X = UnitX(Factor=1)
align = AlignPlane(Plane=dpo.Planes, Direction=X)  # -> Plane, Angle
panel = Panel(pg)
split = SplitList(List=align.Plane, Index="1")  # -> ListA, ListB
cv = ConvertVelocityMmMinToMmS(Velocity=number_slider)
jt = JointTarget(Name="home_pos")
list = ValueList({"MoveAbsJ": 0, "MoveL": 1, "MoveJ": 2}, selected="MoveAbsJ")
sd = SpeedData(Name="printing_speed", TCPVelocity=cv, ORIVelocity=500, LEAXVelocity=5000, REAXVelocity=1000)
list_2 = ValueList({"v5": 5, "v10": 10, "v20": 20, "v30": 30, "v40": 40, "v50": 50, "v60": 60, "v80": 80, "v100": 100, "v150": 150, "v200": 200, "v300": 300, "v400": 400, "v500": 500, "v600": 600, "v800": 800, "v1000": 1000, "v1500": 1500, "v2000": 2000, "v2500": 2500, "v3000": 3000, "v4000": 4000, "v5000": 5000, "v6000": 6000, "v7000": 7000}, selected="v200")
rt = RobotTarget(Name="start", Plane=split.ListA, AxisConfiguration=0, Set_External_Joint_Position=False, Set_Reference_Plane=False)
rt_2 = RobotTarget(Name="print", Plane=split.ListB, AxisConfiguration=0, Set_External_Joint_Position=False, Set_Reference_Plane=False)
M = Move(
    Target=jt,
    SpeedData=list_2,
    MovementType=list,
    Override_Robot_Tool=False,
    Override_Work_Object=False,
    Set_Digital_Output=False)
list_3 = ValueList({"MoveAbsJ": 0, "MoveL": 1, "MoveJ": 2}, selected="MoveJ")
list_4 = ValueList({"MoveAbsJ": 0, "MoveL": 1, "MoveJ": 2}, selected="MoveL")
list_5 = ValueList({"v5": 5, "v10": 10, "v20": 20, "v30": 30, "v40": 40, "v50": 50, "v60": 60, "v80": 80, "v100": 100, "v150": 150, "v200": 200, "v300": 300, "v400": 400, "v500": 500, "v600": 600, "v800": 800, "v1000": 1000, "v1500": 1500, "v2000": 2000, "v2500": 2500, "v3000": 3000, "v4000": 4000, "v5000": 5000, "v6000": 6000, "v7000": 7000}, selected="v200")
M_2 = Move(
    Target=rt,
    SpeedData=list_5,
    MovementType=list_3,
    Override_Robot_Tool=False,
    Override_Work_Object=False,
    Set_Digital_Output=False)
M_3 = Move(
    Target=rt_2,
    SpeedData=sd,
    MovementType=list_4,
    Override_Robot_Tool=False,
    Override_Work_Object=False,
    Set_Digital_Output=False)
robpres = RobotPreset(PositionPlane=PlaneXY(0, 0, 0))
merge_2 = Merge(Data1=flatten(M), Data2=flatten(M_2), Data3=flatten(M_3), Data4=flatten(M))
rg = RAPIDGenerator(Robot=robpres, Action=merge_2, ProgramName="MainModule", SystemName="BASE", Update=Button())  # -> ProgramModule, SystemModule
pg_2 = PathGenerator(
    Robot=robpres,
    Action=merge_2,
    Interpolations=5,
    AnimationSlider=Slider(0, range=0..1),
    Update=Button(),
    Output_Error_Messages=False,
    Output_External_Axis_Planes=False,
    Output_External_Joint_Position=False,
    Output_External_Joint_Positions=False,
    Output_Robot_End_Plane=False,
    Output_Robot_End_Planes=False,
    Output_Robot_Joint_Position=False,
    Output_Robot_Joint_Positions=False,
    Set_Preview_Mesh=True)
