# Grasshopper definition 20210528 - Salad Slicer.gh (Grasshopper 1.0.7)
# plug-ins: Salad Slicer

# ----
# Print bed
number_slider = Slider(5000, range=0..10000)
xy = XYPlane(Origin=Point(0, 0, 0))
pv = PlaneVisualizer(Plane=xy)
planesrf = PlaneSurface(Plane=xy, XSize=number_slider, YSize=Slider(3000, range=0..10000))
preview = CustomPreview(Geometry=planesrf, Material=ColourSwatch(SwatchColor=RGB(224, 224, 224)))

# ----
# Header
panel = Panel("""; PRINTER SETTINGS + START POSITION
  
G500
G90 G1 X5400.0 Y0.0 Z-2000 F10000.0 ; START BUCKKET
  
TANG(C,X,Y,1)
TANGON(C,0)
  
BSPLINE
G642
F10000.0
  
G54 ; X3900 Y400 Z-2434
  
  """)
cl = CodeLine(Code=panel)

# ----
# Footer
panel_2 = Panel("""; END MOVE
G91 X200.0 Y-200.0 Z200.0 ;RELATIVE
 
; END POSITION
 
G500
G90 G1 X8900.0 Y0.0 Z-2000 F10000.0 ; END BUCKET (START X+3300)
  
  """)
cl_2 = CodeLine(Code=panel_2)

# ----
# Path in between objects
crv = Curve(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)
flip = FlipCurve(Curve=crv)  # -> Curve, Flag
cs = CurveSlicer(Curve=flip.Curve, Distance=20)

# ----
# 2.5D object
number_slider_2 = Slider(9.25, range=0..10)
series = Series(Start=0, Step=number_slider_2, Count=Slider(15, range=0..100))
crv_2 = Curve(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)
planar_2_5d_slicer = Planar25DSlicer(Curve=crv_2, Parameter=Slider(0.428, range=0..1), Length=100, Distance=20, Heights=series)

# ----
# Copy objects
number_slider_3 = Slider(8, range=0..10)
series_2 = Series(Start=0, Step=Slider(400, range=0..1000), Count=number_slider_3)
X = UnitX(Factor=series_2)
move = Move(Geometry=cs, Motion=X)  # -> Geometry, Transform
move_2 = Move(Geometry=planar_2_5d_slicer, Motion=X)  # -> Geometry, Transform

weave = Weave(Pattern=[0, 1], Stream0=move.Geometry, Stream1=move_2.Geometry, NullGaps=False)
merge = Merge(Data1=flatten(cl), Data2=flatten(weave), Data3=flatten(cl_2))

# ----
# Whole path interpolated
dpo = DeconstructProgramObject(ProgramObject=weave)  # -> Path, flatten(Planes), StartPlane, EndPlane
intcrv = Interpolate(Vertices=dpo.Planes, Degree=3, Periodic=False, KnotStyle=1)  # -> Curve, Length, Domain

pg = ProgramGenerator(ProgramObjectsLines=merge)

# ----
# Time in minutes
len = Length(Curve=intcrv.Curve)
expression = Expression(x=len, Expression="x/100/60")
panel_3 = Panel(expression)

panel_4 = Panel(pg)
