# Grasshopper definition 20210505 - Current state of development.gh (Grasshopper 1.0.7)
# plug-ins: Salad Slicer

series = Series(Start=0, Step=Slider(10, range=0..10), Count=Slider(100, range=0..100))
panel = Panel("""TANG(C,X,Y,1)
TANGON(C,0)""")
# Add reference plane parameter?
# Add input parameter with printer settings?
# - Tang
# - Feedrate
# - Work offset (G500, G54, G55, G56, G57)
# - Interpolate (BSPLINE) or linear (G1)
expression = Expression(x=series, Expression="x^0.98")
panel_2 = Panel(expression)
series_2 = Series(Start=0, Step=Slider(9.25, range=0..10), Count=Slider(50, range=0..100))
crv = Curve(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)
crv_2 = Curve(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)
X = UnitX(Factor=Slider(2000, range=0..10000))
cl = CodeLine(Code=panel)
cl_2 = CodeLine(Code="G54")
F = SetFeedrate(Feedrate=Slider(10000, range=0..10000))
planar_2_5d_slicer = Planar25DSlicer(
    Curve=crv,
    Parameter=Slider(0.213, range=0..1),
    Length=Slider(100, range=0..100),
    Distance=Slider(50, range=0..1000),
    Heights=series_2)
planar_2_5d_slicer_2 = Planar25DSlicer(
    Curve=crv_2,
    Parameter=Slider(0.575, range=0..1),
    Length=Slider(100, range=0..100),
    Distance=Slider(50, range=0..1000),
    Heights=expression)
# Add Goo and Parameter class
# Add Transform and IsPreview methods
move = Move(Geometry=planar_2_5d_slicer_2, Motion=X)  # -> Geometry, Transform
merge = Merge(
    Data1=flatten(cl),
    Data2=flatten(F),
    Data3=flatten(cl_2),
    Data4=flatten(planar_2_5d_slicer),
    Data5=flatten(planar_2_5d_slicer_2))
pg = ProgramGenerator(ProgramObjects=merge)
# Make proper deconstruct component
merge_2 = Merge(Data1=planar_2_5d_slicer, Data2=planar_2_5d_slicer_2)
panel_3 = Panel(pg)
python = GhPythonScript(x=merge_2)  # -> out, a, b, c, d, e
# ---------- python: Python ----------
a = x.GetPoints()
b = x.GetInterpolatedPath()
c = x.Frames
d = x.Path
e = x.Contours
# ---------- end python ----------
pt = Point(python.a)
crv_3 = Curve(python.b)
pln = Plane(python.c)
crv_4 = Curve(python.d)
crv_5 = Curve(python.e)
pv = PlaneVisualizer(Plane=pln)
