# Grasshopper definition 02_Planar_2D_Slicer_mulitple_objects.gh (Grasshopper 1.0.7)
# plug-ins: Salad Slicer

# ----
# License and author information
I = Info()
panel = Panel(I)

# ----
# Entry path
# entry
crv = Curve(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)
flip = FlipCurve(Curve=crv)  # -> Curve, Flag
cs = CurveSlicer(Curve=flip.Curve, Distance=Slider(20, range=0..100))

# ----
# Sliced object
# Contour
crv_2 = Curve(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)
end = EndPoints(Curve=flip.Curve)  # -> Start, End
X = UnitX(Factor="10")
move = Move(Geometry=end.End, Motion=X)  # -> Geometry, Transform
flip_2 = FlipCurve(Curve=crv_2)  # -> Curve, Flag
scp = SeamAtClosestPoint(Curve=flip_2.Curve, Point=move.Geometry)
series = Series(Start=0, Step=Slider(9.25, range=0..10), Count=Slider(50, range=0..100))
closed_planar_2_5d_slicer = ClosedPlanar25DSlicer(Curve=scp, SeamLocation=0, SeamLength=Slider(100, range=0..1000), Distance=Slider(20, range=0..100), Heights=series)

# ----
# Print bed
number_slider = Slider(5000, range=0..10000)
xy = XYPlane(Origin=Point(0, 0, 0))
pv = PlaneVisualizer(Plane=xy)
planesrf = PlaneSurface(Plane=xy, XSize=number_slider, YSize=Slider(3000, range=0..10000))
Z = UnitZ(Factor="-100")
extr = Extrude(Base=planesrf, Direction=Z)
preview = CustomPreview(Geometry=extr, Material=ColourSwatch(SwatchColor=RGB(224, 224, 224)))

# ----
# Exit point
number_slider_2 = Slider(200, range=0..1000)
neg = Negative(Value=number_slider_2)
ef = GetEndFrames(ProgramObject=closed_planar_2_5d_slicer)  # -> StartFrame, EndFrame
vec = VectorXYZ(XComponent=number_slider_2, YComponent=neg, ZComponent=0)  # -> Vector, Length
move_2 = Move(Geometry=ef.EndFrame, Motion=vec.Vector)  # -> Geometry, Transform
ac = AbsoluteCoordinate(Plane=move_2.Geometry)

# ----
# Copy and weave objects
number_slider_3 = Slider(4, range=0..10)
series_2 = Series(Start=0, Step=Slider(800, range=0..1000), Count=number_slider_3)
X_2 = UnitX(Factor=series_2)
move_3 = Move(Geometry=cs, Motion=X_2)  # -> Geometry, Transform
move_4 = Move(Geometry=closed_planar_2_5d_slicer, Motion=X_2)  # -> Geometry, Transform
move_5 = Move(Geometry=ac, Motion=X_2)  # -> Geometry, Transform
weave = Weave(
    Pattern=[0, 1, 2],
    Stream0=graft(move_3.Geometry),
    Stream1=graft(move_4.Geometry),
    Stream2=graft(move_5.Geometry),
    NullGaps=False)  # -> flatten(Weave)

# ----
# Get data from slicer object
po = ProgramObject(closed_planar_2_5d_slicer)

# ----
# Contours
C = GetContours(ProgramObject=po)
end_2 = EndPoints(Curve=C)  # -> Start, End

# ----
# Interpolated path
ip = GetInterpolatedPath(ProgramObject=po)

# ----
# Start and end frame
ef_2 = GetEndFrames(ProgramObject=po)  # -> StartFrame, EndFrame
pv_2 = PlaneVisualizer(Plane=ef_2.StartFrame)
pv_3 = PlaneVisualizer(Plane=ef_2.EndFrame)

# ----
# All frames
F = GetFrames(ProgramObject=po)
pv_4 = PlaneVisualizer(Plane=F)

# ----
# Bucket position end
item = ListItem(List=reverse(ac), Index=0, Wrap=True)
pdecon = Deconstruct(Point=item)  # -> XComponent, YComponent, ZComponent
pt = ConstructPoint(XCoordinate=pdecon.XComponent, YCoordinate="-250", ZCoordinate="500")
ac_2 = AbsoluteCoordinate(Plane=pt)

# ----
# Header with printer settings
panel_2 = Panel("""; SETTINGS
  
G54 ; Work offset
G90 ; Absolute coords 
G1 ; Linear
 
TANG(C,X,Y,1)
TANGON(C,0)
 """)
cl = CodeLine(Code=panel_2)

# ----
# Bucket position start
pdecon_2 = Deconstruct(Point=end.Start)  # -> XComponent, YComponent, ZComponent
pt_2 = ConstructPoint(XCoordinate=pdecon_2.XComponent, YCoordinate="-250", ZCoordinate="500")
ac_3 = AbsoluteCoordinate(Plane=pt_2)

# ----
# Set feedrate
number_slider_4 = Slider(10000, range=0..10000)
F_2 = SetFeedrate(Feedrate=number_slider_4)

merge = Merge(Data1=flatten(cl), Data2=flatten(F_2), Data3=flatten(ac_3), Data4=flatten(weave), Data5=flatten(ac_2))

# ----
# Generate NC program
pg = ProgramGenerator(ProgramObjectsLines=merge)
panel_3 = Panel(pg)
