# Grasshopper definition 03_Planar_3D_Slicer.gh (Grasshopper 1.0.7)
# plug-ins: Salad Slicer

# ----
# License and author information
I = Info()
panel = Panel(I)

# ----
# Print bed
number_slider = Slider(5000, range=0..10000)
xy = XYPlane(Origin=Point(0, 0, 0))
pv = PlaneVisualizer(Plane=xy)
planesrf = PlaneSurface(Plane=xy, XSize=number_slider, YSize=Slider(3000, range=0..10000))
Z = UnitZ(Factor="-100")
extr = Extrude(Base=planesrf, Direction=Z)
preview = CustomPreview(Geometry=extr, Material=ColourSwatch(SwatchColor=RGB(224, 224, 224)))

# ----
# Header with printer settings
panel_2 = Panel("""; SETTINGS
  
G54 ; Work offset
G90 ; Absolute coords 
G1 ; Linear
 
TANG(C,X,Y,1)
TANGON(C,0)
 """)
cl = CodeLine(Code=panel_2)

# ----
# Set feedrate
number_slider_2 = Slider(10000, range=0..10000)
F = SetFeedrate(Feedrate=number_slider_2)

# ----
# Create mesh
panel_3 = Panel("-200 to 200")
pt = Point(Point(689.1907385, 540.5684686, 0))
pt_2 = Point(Point(689.63676, 550.413796, 734.7987435))
cir = Circle(Plane=pt, Radius="300")
rectangle = Rectangle(Plane=pt_2, XSize="-250 to 250", YSize=panel_3, Radius="50")  # -> Rectangle, Length
rotate = Rotate(Geometry=rectangle.Rectangle, Angle=degrees("45"), Plane=pt_2)  # -> Geometry, Transform
loft = Loft(
    Curves=[cir, rotate.Geometry],
    Options={Adjust=False, Closed=False, LoftEnds=0, LoftSimp=0, LoftType=0, Rebuild=10, Refit=0.01})
custom_mesh_settings = SettingsCustom(
    StitchSeams=True,
    SimplePlanes=False,
    Refine=True,
    MinCount=16,
    MaxCount=400,
    AspectRatio=20,
    MaxDistance=0,
    MaxAngle=20,
    MinEdge=0,
    MaxEdge=Slider(10, range=0..10))

mesh = MeshBrep(Brep=loft, Settings=custom_mesh_settings)

mesh_2 = Mesh(mesh)

# ----
# Slice object
number_slider_3 = Slider(0.57, range=0..1)
cp3d = ClosedPlanar3DSlicer(
    Mesh=mesh_2,
    SeamLocation=number_slider_3,
    SeamLength=Slider(100, range=0..1000),
    Distance=Slider(10, range=0..100),
    Reverse=Toggle(False),
    Heights=Slider(10, range=0..10))

# ----
# Get data from slicer object
po = ProgramObject(cp3d)

# ----
# Contours
C = GetContours(ProgramObject=po)
end = EndPoints(Curve=C)  # -> Start, End

# ----
# Interpolated path
ip = GetInterpolatedPath(ProgramObject=po)

# ----
# Start and end frame
ef = GetEndFrames(ProgramObject=po)  # -> StartFrame, EndFrame
pv_2 = PlaneVisualizer(Plane=ef.StartFrame)
pv_3 = PlaneVisualizer(Plane=ef.EndFrame)

# ----
# All frames
F_2 = GetFrames(ProgramObject=po)
pv_4 = PlaneVisualizer(Plane=F_2)

# ----
# Bucket position, entry and exit point
ef_2 = GetEndFrames(ProgramObject=cp3d)  # -> StartFrame, EndFrame
pt_3 = Point(ef_2.EndFrame)
pt_4 = Point(ef_2.StartFrame)
Y = UnitY(Factor=Slider(-200, range=-500..500))
Y_2 = UnitY(Factor=Slider(-200, range=-500..500))
move = Move(Geometry=pt_4, Motion=Y)  # -> Geometry, Transform
move_2 = Move(Geometry=pt_3, Motion=Y_2)  # -> Geometry, Transform
pdecon = Deconstruct(Point=move.Geometry)  # -> XComponent, YComponent, ZComponent
pt_5 = ConstructPoint(XCoordinate=pdecon.XComponent, YCoordinate="-250", ZCoordinate="500")
ac = AbsoluteCoordinate(Plane=move.Geometry)
ac_2 = AbsoluteCoordinate(Plane=pt_5)
ac_3 = AbsoluteCoordinate(Plane=move_2.Geometry)

merge = Merge(
    Data1=flatten(cl),
    Data2=flatten(F),
    Data3=flatten(ac),
    Data4=flatten(ac_2),
    Data5=flatten(cp3d),
    Data6=flatten(ac_3),
    Data7=flatten(ac))

# ----
# Generate NC program
pg = ProgramGenerator(ProgramObjectsLines=merge)
panel_4 = Panel(pg)
