# Grasshopper definition Planar_3D_Slicer.gh (Grasshopper 1.0.7)
# plug-ins: Salad Slicer

# ----
# License and author information
I = Info()
panel = Panel(I)

# ----
# Create mesh
panel_2 = Panel("-200 to 200")
pt = Point(Point(689.1907385, 540.5684686, 0))
pt_2 = Point(Point(689.63676, 550.413796, 734.7987435))
cir = Circle(Plane=pt, Radius="300")
rectangle = Rectangle(Plane=pt_2, XSize="-250 to 250", YSize=panel_2, Radius="50")  # -> Rectangle, Length
rotate = Rotate(Geometry=rectangle.Rectangle, Angle=degrees("45"), Plane=pt_2)  # -> Geometry, Transform
loft = Loft(
    Curves=[cir, rotate.Geometry],
    Options={Adjust=False, Closed=False, LoftEnds=0, LoftSimp=0, LoftType=0, Rebuild=10, Refit=0.01})
mesh = Mesh(loft)

# ----
# TODO!
# Header
panel_3 = Panel("""; PRINTER SETTINGS + START POSITION
  
G54
G90 G1 X1600.0 Y-250.0 Z500.0 F10000.0 ; START BUCKKET
  
TANG(C,X,Y,1)
TANGON(C,0)
  
BSPLINE
G642
F10000.0
  
G54 ; X3900 Y400 Z-2385
  
  """)  # disabled
cl = CodeLine(Code=panel_3)  # disabled

# ----
# Footer
panel_4 = Panel("""; END MOVE
G91 X200.0 Y-200.0 Z200.0 ;RELATIVE
 
; END POSITION
 
G54
G90 G1 X4700.0 Y-250.0 Z500.0 F10000.0 ; END BUCKET
  
  """)  # disabled
cl_2 = CodeLine(Code=panel_4)  # disabled

# ----
# Slice object
number_slider = Slider(0.68, range=0..1)
cp3d = ClosedPlanar3DSlicer(
    Mesh=mesh,
    SeamLocation=number_slider,
    SeamLength=Slider(200, range=0..1000),
    Distance=Slider(50, range=0..100),
    Reverse=Toggle(False),
    Heights=Slider(10, range=0..10))

# ----
# Set feedrate
number_slider_2 = Slider(10000, range=0..10000)
F = SetFeedrate(Feedrate=number_slider_2)

# ----
# Print bed
number_slider_3 = Slider(5000, range=0..10000)
xy = XYPlane(Origin=Point(0, 0, 0))
pv = PlaneVisualizer(Plane=xy)
planesrf = PlaneSurface(Plane=xy, XSize=number_slider_3, YSize=Slider(3000, range=0..10000))
Z = UnitZ(Factor="-100")
extr = Extrude(Base=planesrf, Direction=Z)
preview = CustomPreview(Geometry=extr, Material=ColourSwatch(SwatchColor=RGB(224, 224, 224)))

# ----
# Get data from slicer object
po = ProgramObject(cp3d)

merge = Merge(Data1=F, Data2=cp3d)

# ----
# Contours
C = GetContours(ProgramObject=po)
end = EndPoints(Curve=C)  # -> Start, End

# ----
# Start and end frame
ef = GetEndFrames(ProgramObject=po)  # -> StartFrame, EndFrame
pv_2 = PlaneVisualizer(Plane=ef.StartFrame)
pv_3 = PlaneVisualizer(Plane=ef.EndFrame)

# ----
# All frames
F_2 = GetFrames(ProgramObject=po)
pv_4 = PlaneVisualizer(Plane=F_2)

# ----
# Generate NC program
pg = ProgramGenerator(ProgramObjectsLines=merge)
panel_5 = Panel(pg)
