# Grasshopper definition 04_Planar_2D_Slicer_FDM_printing.gh (Grasshopper 1.0.7)
# plug-ins: Salad Slicer

# ----
# License and author information
I = Info()
panel = Panel(I)

crv = Curve(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)

# ----
# Sliced object
# Contour
number_slider = Slider(20, range=0..50)
layer_height = Slider(0.2, range=0..1)
series = Series(Start=0, Step=layer_height, Count=number_slider)
closed_planar_2_5d_slicer = ClosedPlanar25DSlicer(Curve=crv, SeamLocation=0, SeamLength=Slider(2, range=0..1000), Distance=Slider(1, range=0..100), Heights=series)

# ----
# Add variable to slicer object
filament_diameter = Slider(1.75, range=0..10)
layer_width = Slider(0.5, range=0..1)
expression = Expression(d=filament_diameter, b=layer_width, h=layer_height, Expression="1/4*pi*d^2/(b*h)")
get_distances_along_contours = GetDistancesAlongContours(SlicerObject=closed_planar_2_5d_slicer)
division = Division(A=get_distances_along_contours, B=expression)
add_variable = AddVariable(SlicerObject=closed_planar_2_5d_slicer, Prefix="E", Values=division)

# ----
# Define printer
hot_end_temperature = Slider(200, range=0..1000)
bed_temperature = Slider(50, range=0..100)
list = ValueList({"Sinumerik": 0, "Marlin": 1}, selected="Marlin")
list_2 = ValueList({"G642": 0, "G1": 1}, selected="G1")
printer_settings = PrinterSettings(ProgramType=list, InterpolationType=list_2, HotEndTemperature=hot_end_temperature, BedTemperature=bed_temperature)

# ----
# Get data from slicer object
po = ProgramObject(closed_planar_2_5d_slicer)

# ----
# Set feedrate
number_slider_2 = Slider(4800, range=0..10000)
F = SetFeedrate(Feedrate=number_slider_2)

# ----
# Contours
C = GetContours(ProgramObject=po)
end = EndPoints(Curve=C)  # -> Start, End

# ----
# Interpolated path
ip = GetInterpolatedPath(ProgramObject=po)

# ----
# Start and end frame
ef = GetEndFrames(ProgramObject=po)  # -> StartFrame, EndFrame
pv = PlaneVisualizer(Plane=ef.StartFrame)
pv_2 = PlaneVisualizer(Plane=ef.EndFrame)

# ----
# All frames
F_2 = GetFrames(ProgramObject=po)
pv_3 = PlaneVisualizer(Plane=F_2)

merge = Merge(Data1=flatten(printer_settings), Data2=flatten(F), Data3=flatten(add_variable))

# ----
# Generate NC program
pg = ProgramGenerator(ProgramObjectsLines=merge)
panel_2 = Panel(pg)
