# Grasshopper definition 05_Nozzles.gh (Grasshopper 1.0.7)
# plug-ins: Salad Slicer

# ----
# 32 mm hose - 41.5/35 mm pipe
number_slider = Slider(30, range=0..100)
# Large scale system
number_slider_2 = Slider(24.5, range=0..100)
rounoz = RoundNozzle(
    Length1=number_slider_2,
    Length2=Slider(75.5, range=0..100),
    Length3=Slider(20, range=0..100),
    OuterDiameter=Slider(41.5, range=0..100),
    InnerDiameter=Slider(35, range=0..100),
    NozzleDiameter=number_slider,
    WallThickness=Slider(5, range=0..10),
    Gap=Slider(1, range=0..10))
preview = CustomPreview(Geometry=rounoz, Material=ColourSwatch(SwatchColor=RGB(168, 168, 168)))

# ----
# License and author information
I = Info()
panel = Panel(I)

# ----
# 25 mm hose - 38/27 mm pipe
number_slider_3 = Slider(38.5, range=0..100)
recnozty1 = RectangularNozzleType1(
    BoxWidth=Slider(70, range=0..100),
    BoxDept=Slider(50, range=0..100),
    FilletRadius=Slider(10, range=0..20),
    Length1=Slider(24.5, range=0..100),
    Length2=Slider(75.5, range=0..100),
    Length3=Slider(25, range=0..100),
    Length4=Slider(25, range=0..100),
    OuterDiameter=number_slider_3,
    InnerDiameter=Slider(27, range=0..100),
    NozzleWidth=Slider(50, range=0..100),
    NozzleHeight=Slider(10, range=0..100),
    Divide=Toggle(False))
X = UnitX(Factor=Slider(300, range=0..1000))
move = Move(Geometry=recnozty1, Motion=X)  # -> Geometry, Transform
preview_2 = CustomPreview(Geometry=move.Geometry, Material=ColourSwatch(SwatchColor=RGB(168, 168, 168)))

# ----
# 25 mm hose - 38/27 mm pipe
number_slider_4 = Slider(38.5, range=0..100)
recnozty1_2 = RectangularNozzleType2(
    Length1=Slider(24.5, range=0..100),
    Length2=Slider(75.5, range=0..100),
    Length3=Slider(25, range=0..100),
    Length4=Slider(25, range=0..100),
    OuterDiameter=number_slider_4,
    InnerDiameter=Slider(27, range=0..100),
    NozzleWidth=Slider(50, range=0..100),
    NozzleHeight=Slider(10, range=0..100),
    WallThickness=Slider(6, range=0..10),
    Gap=Slider(1, range=0..10))
X_2 = UnitX(Factor=Slider(150, range=0..1000))
move_2 = Move(Geometry=recnozty1_2, Motion=X_2)  # -> Geometry, Transform
preview_3 = CustomPreview(Geometry=move_2.Geometry, Material=ColourSwatch(SwatchColor=RGB(168, 168, 168)))

# ----
# Round
number_slider_5 = Slider(25, range=0..100)
# Caulking gun
number_slider_6 = Slider(15, range=0..100)
rounoz_2 = RoundNozzle(
    Length1=number_slider_6,
    Length2=Slider(40, range=0..100),
    Length3=Slider(20, range=0..100),
    OuterDiameter=Slider(38.2, range=0..100),
    InnerDiameter=Slider(34.2, range=0..100),
    NozzleDiameter=number_slider_5,
    WallThickness=Slider(4, range=0..10),
    Gap=Slider(0.5, range=0..10))
vec = VectorXYZ(XComponent=Slider(0, range=0..1000), YComponent=Slider(150, range=0..1000), ZComponent=0)  # -> Vector, Length
move_3 = Move(Geometry=rounoz_2, Motion=vec.Vector)  # -> Geometry, Transform
preview_4 = CustomPreview(Geometry=move_3.Geometry, Material=ColourSwatch(SwatchColor=RGB(168, 168, 168)))

# ----
# Rectangle
number_slider_7 = Slider(38.2, range=0..100)
recnozty1_3 = RectangularNozzleType2(
    Length1=Slider(15, range=0..100),
    Length2=Slider(40, range=0..100),
    Length3=Slider(0, range=0..100),
    Length4=Slider(20, range=0..100),
    OuterDiameter=number_slider_7,
    InnerDiameter=Slider(34.2, range=0..100),
    NozzleWidth=Slider(50, range=0..100),
    NozzleHeight=Slider(10, range=0..100),
    WallThickness=Slider(4, range=0..10),
    Gap=Slider(0.5, range=0..10))
vec_2 = VectorXYZ(XComponent=Slider(150, range=0..1000), YComponent=Slider(150, range=0..1000), ZComponent=0)  # -> Vector, Length
move_4 = Move(Geometry=recnozty1_3, Motion=vec_2.Vector)  # -> Geometry, Transform
preview_5 = CustomPreview(Geometry=move_4.Geometry, Material=ColourSwatch(SwatchColor=RGB(168, 168, 168)))
