# Grasshopper definition RC_02_Planar_2D_slicer_multiple_objects.gh (Grasshopper 1.0.7)
# plug-ins: Robot Components, Salad Slicer

# ----
# Salad Slicer: License and author information
I = Info()
panel = Panel(I)

# ----
# End-effector
panel_2 = Panel("-12.85")
# Curve instructions
# Rhino top view
# y-axis
panel_3 = Panel("145")
pt = ConstructPoint(XCoordinate="19 + 257", YCoordinate=panel_2, ZCoordinate=panel_3)
yz = YZPlane(Origin=pt)
prot = RotatePlane(Plane=yz, Angle=degrees("90"))
mesh = Mesh([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])
robtool = RobotTool(Name="printhead", Mesh=mesh, AttachmentPlane=PlaneXY(0, 0, 0), ToolPlane=prot)

# ----
# 2
# 3
# Input parameters
# 1
# x-axis
# Draw curves opposite to the direction of the y-axis.
# Draw the curves parallel to the y-axis.
# Use only even number of layers!
layer_thickness_mm = Slider(10, range=0..20)
number_of_layers = Slider(4, range=0..10)
number_of_layers_2 = Slider(8, range=0..10)
extend_entry_and_exit = Slider(100, range=0..1000)
merge = Merge(Data1=layer_thickness_mm)
merge_2 = Merge(Data1=number_of_layers, Data2=number_of_layers_2)

# ----
# First layers as curves
crv = Curve([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])

# ----
# Bucket position (start and end)
pt_2 = Point(Point(746.9634149, 520.4604634, 268.5777364))

# ----
# Salad slicer objects
series = Series(Start=0, Step=merge, Count=merge_2)
open_planar_2_5d_slicer = OpenPlanar25DSlicer(Curve=graft(crv), Distance=20, Heights=series)
C = GetContours(SlicerObject=open_planar_2_5d_slicer)

# ----
# Robot
robpres = RobotPreset(PositionPlane=PlaneXY(0, 0, 0), RobotTool=robtool, Robot_Preset_Number=4)

# ----
# Robot Components: License and author information
I_2 = Info()
panel_4 = Panel(I_2)

# ----
# Check of robot setup
pt_3 = Point(Point(761.2941581, 99.74967925, 83.06784054))
xy = XYPlane(Origin=pt_3)
flip_plane_y = FlipPlaneY(Plane=xy)
ik = InverseKinematics(Robot=robpres, Movement=flip_plane_y, Closest_Robot_Joint_Position=False, Output_Posed_Meshes=False, Set_Hide_Mesh=False)  # -> RobotJointPosition, ExternalJointPosition
pv = PlaneVisualizer(Plane=flip_plane_y)

# ----
# Create target planes
end = EndPoints(Curve=C)  # -> Start, End
weave = Weave(Pattern=[0, 1], Stream0=end.Start, Stream1=end.End, NullGaps=False)
xy_2 = XYPlane(Origin=weave)
flip_plane_y_2 = FlipPlaneY(Plane=xy_2)
item = ListItem(List=flip_plane_y_2, Index=0, Wrap=True)  # -> Item1, Item
Y = UnitY(Factor=extend_entry_and_exit)
move = Move(Geometry=item.Item, Motion=Y)  # -> Geometry, Transform
move_2 = Move(Geometry=item.Item1, Motion=Y)  # -> Geometry, Transform
merge_3 = Merge(Data1=move.Geometry, Data2=flip_plane_y_2, Data3=move_2.Geometry)  # -> flatten(Result)

# ----
# Printing speed
number_slider = Slider(100, range=0..200)
sd = SpeedData(Name="print_speed", TCPVelocity=number_slider, ORIVelocity=500, LEAXVelocity=5000, REAXVelocity=1000)

# ----
# Robot instructions
xy_3 = XYPlane(Origin=pt_2)
flip_plane_y_3 = FlipPlaneY(Plane=xy_3)
rt = RobotTarget(Plane=flip_plane_y_3, Set_External_Joint_Position=False, Set_Reference_Plane=False)
rt_2 = RobotTarget(Plane=merge_3, Set_External_Joint_Position=False, Set_Reference_Plane=False)
list = ValueList({"MoveAbsJ": 0, "MoveL": 1, "MoveJ": 2, "MoveC": 3}, selected="MoveJ")
list_2 = ValueList({"MoveAbsJ": 0, "MoveL": 1, "MoveJ": 2, "MoveC": 3}, selected="MoveL")
list_3 = ValueList({"MoveAbsJ": 0, "MoveL": 1, "MoveJ": 2, "MoveC": 3}, selected="MoveAbsJ")
list_4 = ValueList({"MoveAbsJ": 0, "MoveL": 1, "MoveJ": 2, "MoveC": 3}, selected="MoveJ")
merge_4 = Merge(Data1=list, Data2=list_2)
list_5 = ValueList({"v5": 5, "v10": 10, "v20": 20, "v30": 30, "v40": 40, "v50": 50, "v60": 60, "v80": 80, "v100": 100, "v150": 150, "v200": 200, "v300": 300, "v400": 400, "v500": 500, "v600": 600, "v800": 800, "v1000": 1000, "v1500": 1500, "v2000": 2000, "v2500": 2500, "v3000": 3000, "v4000": 4000, "v5000": 5000, "v6000": 6000, "v7000": 7000}, selected="v200")
list_6 = ValueList({"v5": 5, "v10": 10, "v20": 20, "v30": 30, "v40": 40, "v50": 50, "v60": 60, "v80": 80, "v100": 100, "v150": 150, "v200": 200, "v300": 300, "v400": 400, "v500": 500, "v600": 600, "v800": 800, "v1000": 1000, "v1500": 1500, "v2000": 2000, "v2500": 2500, "v3000": 3000, "v4000": 4000, "v5000": 5000, "v6000": 6000, "v7000": 7000}, selected="v200")
list_7 = ValueList({"z0": 0, "z1": 1, "z5": 5, "z10": 10, "z15": 15, "z20": 20, "z30": 30, "z40": 40, "z50": 50, "z60": 60, "z80": 80, "z100": 100, "z150": 150, "z200": 200, "fine": -1}, selected="z1")
lcc = LinearConfigurationControl(IsActive=False)
M = Move(
    Type=list_3,
    Target=rt,
    SpeedData=list_5,
    Override_Robot_Tool=False,
    Override_Work_Object=False,
    Set_Circular_Point=False,
    Set_Digital_Output=False,
    Set_Movement_Time=False)
M_2 = Move(
    Type=merge_4,
    Target=rt_2,
    SpeedData=sd,
    ZoneData=list_7,
    Override_Robot_Tool=False,
    Override_Work_Object=False,
    Set_Circular_Point=False,
    Set_Digital_Output=False,
    Set_Movement_Time=False)
M_3 = Move(
    Type=list_4,
    Target=rt,
    SpeedData=list_6,
    Override_Robot_Tool=False,
    Override_Work_Object=False,
    Set_Circular_Point=False,
    Set_Digital_Output=False,
    Set_Movement_Time=False)
merge_5 = Merge(Data1=lcc, Data3=M, Data4=M_2, Data5=M_3)

pg = PathGenerator(
    Robot=robpres,
    Action=merge_5,
    Interpolations=Slider(50, range=0..100),
    AnimationSlider=Slider(1, range=0..1),
    Update=Button(),
    Output_Error_Messages=False,
    Output_External_Axis_Planes=False,
    Output_External_Joint_Position=False,
    Output_External_Joint_Positions=False,
    Output_Movement=False,
    Output_Movements=False,
    Output_Path=True,
    Output_Posed_Meshes=False,
    Output_Robot_End_Plane=False,
    Output_Robot_End_Planes=False,
    Output_Robot_Joint_Position=False,
    Output_Robot_Joint_Positions=False,
    Preview_Path=True,
    Preview_Posed_Meshes=True)
rg = RAPIDGenerator(
    Robot=robpres,
    Action=merge_5,
    Update=Button(),
    Add_loaddata=False,
    Add_tooldata=False,
    Add_wobjdata=False,
    Module_Name=False,
    Output_loaddata=False,
    Output_tooldata=False,
    Output_wobjdata=False,
    Routine_Name=False)
panel_5 = Panel(rg)
