# Grasshopper definition 02_Planar_2D_Slicer_multiple_objects.gh (Grasshopper 1.0.8)
# plug-ins: Salad Slicer

# ----
# License and author information
I = Info()
panel = Panel(I)

# ----
# Entry path
# entry
crv = Curve(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)
flip = FlipCurve(Curve=crv)  # -> Curve, Flag
cs = CurveSlicer(Curve=flip.Curve, Distance=Slider(20, range=0..100))

# ----
# Sliced object
# Contour
crv_2 = Curve(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)
end = EndPoints(Curve=flip.Curve)  # -> Start, End
X = UnitX(Factor="10")
move = Move(Geometry=end.End, Motion=X)  # -> Geometry, Transform
flip_2 = FlipCurve(Curve=crv_2)  # -> Curve, Flag
scp = SeamAtClosestPoint(Curve=flip_2.Curve, Point=move.Geometry)
series = Series(Start=0, Step=Slider(9.25, range=0..10), Count=Slider(50, range=0..100))
closed_planar_2_5d_slicer = ClosedPlanar25DSlicer(Curve=scp, SeamLocation=0, SeamLength=Slider(100, range=0..1000), Distance=Slider(20, range=0..100), Heights=series)

# ----
# Print bed
number_slider = Slider(5000, range=0..10000)
xy = XYPlane(Origin=Point(0, 0, 0))
pv = PlaneVisualizer(Plane=xy)
planesrf = PlaneSurface(Plane=xy, XSize=number_slider, YSize=Slider(3000, range=0..10000))
Z = UnitZ(Factor="-100")
extr = Extrude(Base=planesrf, Direction=Z)
preview = CustomPreview(Geometry=extr, Material=ColourSwatch(SwatchColor=RGB(224, 224, 224)))

# ----
# Exit point
number_slider_2 = Slider(200, range=0..1000)
neg = Negative(Value=number_slider_2)
ef = GetEndFrames(ProgramObject=closed_planar_2_5d_slicer)  # -> StartFrame, EndFrame
vec = VectorXYZ(XComponent=number_slider_2, YComponent=neg, ZComponent=0)  # -> Vector, Length
move_2 = Move(Geometry=ef.EndFrame, Motion=vec.Vector)  # -> Geometry, Transform
ac = AbsoluteCoordinate(Plane=move_2.Geometry)

# ----
# Copy and weave objects
number_slider_3 = Slider(4, range=0..10)
series_2 = Series(Start=0, Step=Slider(800, range=0..1000), Count=number_slider_3)
X_2 = UnitX(Factor=series_2)
move_3 = Move(Geometry=cs, Motion=X_2)  # -> Geometry, Transform
move_4 = Move(Geometry=closed_planar_2_5d_slicer, Motion=X_2)  # -> Geometry, Transform
move_5 = Move(Geometry=ac, Motion=X_2)  # -> Geometry, Transform
weave = Weave(
    Pattern=[0, 1, 2],
    Stream0=graft(move_3.Geometry),
    Stream1=graft(move_4.Geometry),
    Stream2=graft(move_5.Geometry),
    NullGaps=False)  # -> flatten(Weave)

# ----
# Get data from slicer object
po = ProgramObject(closed_planar_2_5d_slicer)

# ----
# Path
list = ValueList({"Original": 0, "Spline": 1, "Linear": 2}, selected="Original")
P = GetPath(SlicerObject=po, PathType=list)

# ----
# Contours
C = GetContours(ProgramObject=po)
end_2 = EndPoints(Curve=C)  # -> Start, End

# ----
# Start and end frame
ef_2 = GetEndFrames(ProgramObject=po)  # -> StartFrame, EndFrame
pv_2 = PlaneVisualizer(Plane=ef_2.StartFrame)
pv_3 = PlaneVisualizer(Plane=ef_2.EndFrame)

# ----
# All frames
F = GetFrames(ProgramObject=po)
pv_4 = PlaneVisualizer(Plane=F)

# ----
# Bucket position start
pdecon = Deconstruct(Point=end.Start)  # -> XComponent, YComponent, ZComponent
panel_2 = Panel("""250
500""")
pt = ConstructPoint(XCoordinate=pdecon.XComponent, YCoordinate=panel_2, ZCoordinate="500")
ac_2 = AbsoluteCoordinate(Plane=pt)

# ----
# Bucket position end
item = ListItem(List=reverse(move_5.Geometry), Index=0, Wrap=True)
pdecon_2 = Deconstruct(Point=item)  # -> XComponent, YComponent, ZComponent
pt_2 = ConstructPoint(XCoordinate=pdecon_2.XComponent, YCoordinate=panel_2, ZCoordinate="500")
ac_3 = AbsoluteCoordinate(Plane=pt_2)

# ----
# Set feedrate
number_slider_4 = Slider(6000, range=0..10000)
F_2 = SetFeedrate(Feedrate=number_slider_4)

# ----
# Work offset + tang of
panel_3 = Panel("""G54 ; Work offset
 """)
cl = CodeLine(Code=panel_3)

# ----
# Printer settings
toggle = BooleanToggle(False)
list_2 = ValueList({"Sinumerik": 0, "Marlin": 1}, selected="Sinumerik")
list_3 = ValueList({"Spline": 0, "Linear": 1}, selected="Spline")
S = PrinterSettings(ProgramType=list_2, InterpolationType=list_3, TangentialControl=toggle, HotEndTemperature=-1, BedTemperature=-1)

merge = Merge(
    Data1=flatten(S),
    Data2=flatten(F_2),
    Data3=flatten(cl),
    Data4=flatten(ac_2),
    Data5=flatten(weave),
    Data6=reverse(flatten(ac_3)))

# ----
# Generate NC program
pg = ProgramGenerator(ProgramSlicerObjects=merge, Preview_Path=True)
panel_4 = Panel(pg)
