# Grasshopper definition 04_Planar_2D_Slicer_FDM_printing.gh (Grasshopper 1.0.8)
# plug-ins: Salad Slicer

# ----
# License and author information
I = Info()
panel = Panel(I)

crv = Curve(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)

# ----
# Sliced object
# Contour
number_slider = Slider(20, range=0..50)
layer_height = Slider(0.2, range=0..1)
series = Series(Start=layer_height, Step=layer_height, Count=number_slider)
closed_planar_2_5d_slicer = ClosedPlanar25DSlicer(Curve=crv, SeamLocation=0, SeamLength=Slider(2, range=0..1000), Distance=Slider(1, range=0..100), Heights=series)

# ----
# Get data from slicer object
po = ProgramObject(closed_planar_2_5d_slicer)

# ----
# Start and end frame
ef = GetEndFrames(SlicerObject=po)  # -> StartFrame, EndFrame
pv = PlaneVisualizer(Plane=ef.StartFrame)
pv_2 = PlaneVisualizer(Plane=ef.EndFrame)

# ----
# Contours
C = GetContours(SlicerObject=po)
end = EndPoints(Curve=C)  # -> Start, End

# ----
# Path
list = ValueList({"Original": 0, "Spline": 1, "Linear": 2}, selected="Linear")
P = GetPath(SlicerObject=po, PathType=list)

# ----
# All frames
list_2 = ValueList({"By Layer": 0, "By Oject": 1}, selected="By Layer")
F = GetFrames(SlicerObject=po, Structure=list_2)

# ----
# Add variable to slicer object
filament_diameter = Slider(1.75, range=0..10)
layer_width = Slider(0.5, range=0..1)
list_3 = ValueList({"Original": 0, "Spline": 1, "Linear": 2}, selected="Linear")
expression = Expression(d=filament_diameter, b=layer_width, h=layer_height, Expression="1/4*pi*d^2/(b*h)")
dap = GetDistancesAlongPath(SlicerObject=closed_planar_2_5d_slicer, PathType=list_3)
division = Division(A=dap, B=expression)
av = AddVariable(SlicerObject=closed_planar_2_5d_slicer, Prefix="E", Values=division)

# ----
# Define printer
hot_end_temperature = Slider(200, range=0..1000)
bed_temperature = Slider(50, range=0..100)
list_4 = ValueList({"Sinumerik": 0, "Marlin": 1}, selected="Marlin")
list_5 = ValueList({"G642": 0, "G1": 1}, selected="G1")
S = PrinterSettings(
    ProgramType=list_4,
    InterpolationType=list_5,
    TangentialControl=Toggle(False),
    HotEndTemperature=hot_end_temperature,
    BedTemperature=bed_temperature)

# ----
# Set feedrate
number_slider_2 = Slider(4800, range=0..10000)
F_2 = SetFeedrate(Feedrate=number_slider_2)
cl = CodeLine(Text="G92 E0")

merge = Merge(Data1=flatten(S), Data2=flatten(F_2), Data3=flatten(cl), Data4=flatten(av))
pg = ProgramGenerator(ProgramSlicerObjects=merge, Preview_Path=True)

# ----
# Generate NC program
panel_2 = Panel(pg)
