# Grasshopper definition RC_01_Planar_2D_slicer.gh (Grasshopper 1.0.8)
# plug-ins: Robot Components, Salad Slicer

# ----
# Salad Slicer: License and author information
I = Info()
panel = Panel(I)

# ----
# End-effector
pt = Point(Point(430.0718674, 0, 120))
yz = YZPlane(Origin=pt)
brep = Brep([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])
prot = RotatePlane(Plane=yz, Angle=degrees("90"))
robtool = RobotTool(Name="printhead", Mesh=brep, AttachmentPlane=PlaneXY(0, 0, 0), ToolPlane=prot)

# ----
# Work object
pt_2 = Point(Point(1406.64608, 1059.658774, 42.01374856))
pt_3 = Point(Point(1457.85045, -882.8339347, 49.41075462))
pt_4 = Point(Point(2486.006931, -882.8339347, 85.56074479))
pl_3pt = Plane3Pt(PointA=pt_3, PointB=pt_4, PointC=pt_2)
workobj = WorkObject(Name="printbed", Plane=pl_3pt)

# ----
# Printbead visualization
pt_5 = Point(Point(1400.280025, 4021.054021, 0))
xy = XYPlane(Origin=pt_5)
rectangle = Rectangle(Plane=xy, XSize="0 to 1000", YSize="0 to 2000", Radius=0)  # -> Rectangle, Length
orient = Orient(Geometry=rectangle.Rectangle, Source=xy, Target=pl_3pt)  # -> Geometry, Transform
boundary = BoundarySurfaces(Edges=orient.Geometry)

# ----
# Slicer
number_slider = Slider(10, range=0..100)
number_slider_2 = Slider(9.06, range=0..10)
series = Series(Start=number_slider_2, Step=number_slider_2, Count=number_slider)
crv = Curve(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)
closed_planar_2_5d_slicer = ClosedPlanar25DSlicer(
    Curve=crv,
    SeamLocation=Slider(0.068, range=0..1),
    SeamLength=Slider(100, range=0..1000),
    Distance=Slider(10, range=0..10),
    Heights=series)

# ----
# Robot
robpres = RobotPreset(PositionPlane=PlaneXY(0, 0, 0), RobotTool=robtool, Robot_Preset_Number=22)

# ----
# Check of robot setup
pt_6 = Point(Point(2268.639032, 861.8212579, 1290.227463))
xy_2 = XYPlane(Origin=pt_6)
flip_plane_y = FlipPlaneY(Plane=xy_2)
ik = InverseKinematics(
    Robot=robpres,
    Movement=flip_plane_y,
    Closest_Robot_Joint_Position=False,
    Output_Configuration_Data=False,
    Output_Posed_Meshes=False,
    Set_Hide_Mesh=False)  # -> RobotJointPosition, ExternalJointPosition
pv = PlaneVisualizer(Plane=flip_plane_y)

# ----
# Robot Components: License and author information
I_2 = Info()
panel_2 = Panel(I_2)

list = ValueList({"MoveAbsJ": 0, "MoveL": 1, "MoveJ": 2, "MoveC": 3}, selected="MoveAbsJ")

# ----
# Robot code generation
F = GetFrames(SlicerObject=closed_planar_2_5d_slicer)
X = UnitX(Factor=1)
align = AlignPlane(Plane=F, Direction=X)  # -> Plane, Angle
ef = GetEndFrames(SlicerObject=closed_planar_2_5d_slicer)  # -> StartFrame, EndFrame
X_2 = UnitX(Factor=Slider(200, range=0..1000))
move = Move(Geometry=ef.StartFrame, Motion=X_2)  # -> Geometry, Transform
pt_7 = Point(Point(2790.483413, 117.5012981, 730.4273811))
sd = SpeedData(Name="print_speed", TCPVelocity=Slider(85, range=0..100), ORIVelocity=500, LEAXVelocity=5000, REAXVelocity=1000)
rt = RobotTarget(Plane=move.Geometry, ReferencePlane=xy, Set_External_Joint_Position=False, Set_Reference_Plane=True)
rt_2 = RobotTarget(Plane=align.Plane, ReferencePlane=xy, Set_External_Joint_Position=False, Set_Reference_Plane=True)
xy_3 = XYPlane(Origin=pt_7)
flip_plane_y_2 = FlipPlaneY(Plane=xy_3)
list_2 = ValueList({"Instruction": 0, "Declaration": 1}, selected="Instruction")
list_3 = ValueList({"MoveAbsJ": 0, "MoveL": 1, "MoveJ": 2}, selected="MoveJ")
list_4 = ValueList({"MoveAbsJ": 0, "MoveL": 1, "MoveJ": 2}, selected="MoveL")
list_5 = ValueList({"v5": 5, "v10": 10, "v20": 20, "v30": 30, "v40": 40, "v50": 50, "v60": 60, "v80": 80, "v100": 100, "v150": 150, "v200": 200, "v300": 300, "v400": 400, "v500": 500, "v600": 600, "v800": 800, "v1000": 1000, "v1500": 1500, "v2000": 2000, "v2500": 2500, "v3000": 3000, "v4000": 4000, "v5000": 5000, "v6000": 6000, "v7000": 7000}, selected="v200")
list_6 = ValueList({"v5": 5, "v10": 10, "v20": 20, "v30": 30, "v40": 40, "v50": 50, "v60": 60, "v80": 80, "v100": 100, "v150": 150, "v200": 200, "v300": 300, "v400": 400, "v500": 500, "v600": 600, "v800": 800, "v1000": 1000, "v1500": 1500, "v2000": 2000, "v2500": 2500, "v3000": 3000, "v4000": 4000, "v5000": 5000, "v6000": 6000, "v7000": 7000}, selected="v200")
list_7 = ValueList({"z0": 0, "z1": 1, "z5": 5, "z10": 10, "z15": 15, "z20": 20, "z30": 30, "z40": 40, "z50": 50, "z60": 60, "z80": 80, "z100": 100, "z150": 150, "z200": 200, "fine": -1}, selected="z1")
list_8 = ValueList({"z0": 0, "z1": 1, "z5": 5, "z10": 10, "z15": 15, "z20": 20, "z30": 30, "z40": 40, "z50": 50, "z60": 60, "z80": 80, "z100": 100, "z150": 150, "z200": 200, "fine": -1}, selected="z1")
slcc = SetLinearConfigurationControl(IsActive=False)
sjcc = SetJointConfigurationControl(IsActive=False)
M = Move(
    Type=list_3,
    Target=rt,
    SpeedData=list_6,
    ZoneData=list_7,
    WorkObject=workobj,
    Override_Robot_Tool=False,
    Override_Work_Object=True,
    Set_Circular_Point=False,
    Set_Digital_Output=False,
    Set_Movement_Time=False)
M_2 = Move(
    Type=list_4,
    Target=rt_2,
    SpeedData=sd,
    ZoneData=list_8,
    WorkObject=workobj,
    Override_Robot_Tool=False,
    Override_Work_Object=True,
    Set_Circular_Point=False,
    Set_Digital_Output=False,
    Set_Movement_Time=False)
M_3 = Move(
    Type=list,
    Target=flip_plane_y_2,
    SpeedData=list_5,
    Override_Robot_Tool=False,
    Override_Work_Object=False,
    Set_Circular_Point=False,
    Set_Digital_Output=False,
    Set_Movement_Time=False)
C = Comment(Text="new layer", Type=list_2)
weave = Weave(Pattern=[0, 1], Stream0=C, Stream1=M_2, NullGaps=False)
merge = Merge(Data1=flatten(sjcc), Data2=flatten(slcc), Data3=flatten(M_3), Data4=flatten(M), Data5=flatten(weave), Data6=M_3)
rg = RAPIDGenerator(
    Robot=robpres,
    Action=merge,
    ModuleName="SaladSlicerExampleModule",
    ProcedureName="FormulaCar",
    Update=Button(),
    Add_loaddata=False,
    Add_tooldata=False,
    Add_wobjdata=False,
    Module_Name=True,
    Output_loaddata=False,
    Output_tooldata=False,
    Output_wobjdata=False,
    Routine_Name=True)
panel_3 = Panel(rg)

pg = PathGenerator(
    Robot=robpres,
    Action=merge,
    Interpolations=5,
    AnimationSlider=Slider(0.1951, range=0..1),
    Update=Button(),
    Output_Configuration_Data=False,
    Output_Configuration_Datas=False,
    Output_Error_Messages=False,
    Output_External_Axis_Planes=False,
    Output_External_Joint_Position=False,
    Output_External_Joint_Positions=False,
    Output_Movement=False,
    Output_Movements=False,
    Output_Path=True,
    Output_Posed_Meshes=False,
    Output_Program_Time=False,
    Output_Robot_End_Plane=True,
    Output_Robot_End_Planes=False,
    Output_Robot_Joint_Position=False,
    Output_Robot_Joint_Positions=False,
    Preview_Path=True,
    Preview_Posed_Meshes=True)  # -> Path, RobotEndPlane

pv_2 = PlaneVisualizer(Plane=pg.RobotEndPlane)
