# Grasshopper definition RC_02_Planar_2D_slicer_multiple_objects.gh (Grasshopper 1.0.8)
# plug-ins: Robot Components, Salad Slicer

# ----
# Salad Slicer: License and author information
I = Info()
panel = Panel(I)

# ----
# Work Object
number_slider = Slider(712, range=0..1000)
z_height = Panel("-15")
pt = ConstructPoint(XCoordinate=number_slider, YCoordinate=Slider(199, range=0..1000), ZCoordinate=z_height)
xy = XYPlane(Origin=pt)
workobj = WorkObject(Name="wobj_printbed", Plane=xy)

# ----
# End-effector
tcp = Panel("-160,0,288")
X = UnitX(Factor="-1")
Y = UnitY(Factor="-1")
pl = ConstructPlane(Origin=tcp, XAxis=X, YAxis=Y)
mesh = Mesh([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])
robtool = RobotTool(Name="printhead", Mesh=mesh, AttachmentPlane=PlaneXY(0, 0, 0), ToolPlane=pl)

# ----
# Input parameters
# Use only even number of layers!
layer_thickness_mm = Slider(10, range=0.5..20)
number_of_layers = Slider(6, range=0..10)
number_of_layers_2 = Slider(8, range=0..10)
number_of_layers_3 = Slider(10, range=0..10)
extend_entry_and_exit = Slider(100, range=0..1000)
merge = Merge(Data1=layer_thickness_mm)
merge_2 = Merge(Data1=number_of_layers, Data2=number_of_layers_2, Data3=number_of_layers_3)

# ----
# Bucket position (start and end)
pt_2 = Point(Point(746.9634149, 520.4604634, 268.5777364))

# ----
# Robot
robpres = RobotPreset(PositionPlane=PlaneXY(0, 0, 0), RobotTool=robtool, Robot_Preset_Number=4)

# ----
# Check of robot setup
pt_3 = Point(Point(943.1269084, 99.74967925, 291.3365991))
xy_2 = XYPlane(Origin=pt_3)
flip_plane_y = FlipPlaneY(Plane=xy_2)
pv = PlaneVisualizer(Plane=flip_plane_y)
ik = InverseKinematics(
    Robot=robpres,
    Movement=flip_plane_y,
    Closest_Robot_Joint_Position=False,
    Output_Configuration_Data=False,
    Output_Posed_Meshes=False,
    Set_Hide_Mesh=False)  # -> RobotJointPosition, ExternalJointPosition

# ----
# Robot Components: License and author information
I_2 = Info()
panel_2 = Panel(I_2)

# ----
# Printing speed
number_slider_2 = Slider(100, range=0..200)
sd = SpeedData(Name="print_speed", TCPVelocity=number_slider_2, ORIVelocity=500, LEAXVelocity=5000, REAXVelocity=1000)

wo = WorkObject(workobj)
R = Robot(robpres)
button = Button()

# ----
# Curve example
number_slider_3 = Slider(100, range=0..100)
line_length = Slider(332, range=0..1000)
Y_2 = UnitY(Factor=line_length)
pt_4 = Point(Point(0, 0, 0))
series = Series(Start=Slider(0, range=0..1000), Step=number_slider_3, Count=Slider(4, range=0..10))
neg = Negative(Value=series)
X_2 = UnitX(Factor=neg)

neg_2 = Negative(Value=Y_2)

move = Move(Geometry=pt_4, Motion=neg_2)  # -> Geometry, Transform
# Curve instructions
# Rhino top view
# y-axis
# Draw curves opposite to the direction of the y-axis.
# Draw the curves parallel to the y-axis.
ln = Line(StartPoint=pt_4, EndPoint=move.Geometry)
# 2
# 1
# 3
# x-axis
geo = Geometry(ln)
move_2 = Move(Geometry=geo, Motion=X_2)  # -> Geometry, Transform
disc = Discontinuity(Curve=flatten(move_2.Geometry), Level=1)  # -> flatten(Points), Parameters
crv = Curve(move_2.Geometry)
points = PointList(Points=disc.Points)

# ----
# First layers as curves
crv_2 = Curve(crv)
crv_3 = Curve([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])

# ----
# Salad slicer objects
series_2 = Series(Start=0, Step=merge, Count=merge_2)
open_planar_2_5d_slicer = OpenPlanar25DSlicer(Curve=graft(crv_2), Distance=20, Heights=series_2)
C = GetContours(SlicerObject=open_planar_2_5d_slicer)

# ----
# Create target planes
end = EndPoints(Curve=C)  # -> Start, End
weave = Weave(Pattern=[0, 1], Stream0=end.Start, Stream1=end.End, NullGaps=False)
xy_3 = XYPlane(Origin=weave)
flip_plane_y_2 = FlipPlaneY(Plane=xy_3)
item = ListItem(List=flip_plane_y_2, Index=0, Wrap=True)  # -> Item1, Item
Y_3 = UnitY(Factor=extend_entry_and_exit)
move_3 = Move(Geometry=item.Item, Motion=Y_3)  # -> Geometry, Transform
move_4 = Move(Geometry=item.Item1, Motion=Y_3)  # -> Geometry, Transform
merge_3 = Merge(Data1=move_3.Geometry, Data2=flip_plane_y_2, Data3=move_4.Geometry)  # -> flatten(Result)

# ----
# Robot instructions
xy_4 = XYPlane(Origin=pt_2)
flip_plane_y_3 = FlipPlaneY(Plane=xy_4)
rt = RobotTarget(Plane=flip_plane_y_3, Set_External_Joint_Position=False, Set_Reference_Plane=False)
rt_2 = RobotTarget(Plane=merge_3, Set_External_Joint_Position=False, Set_Reference_Plane=False)
list = ValueList({"MoveAbsJ": 0, "MoveL": 1, "MoveJ": 2, "MoveC": 3}, selected="MoveJ")
list_2 = ValueList({"MoveAbsJ": 0, "MoveL": 1, "MoveJ": 2, "MoveC": 3}, selected="MoveL")
list_3 = ValueList({"MoveAbsJ": 0, "MoveL": 1, "MoveJ": 2, "MoveC": 3}, selected="MoveAbsJ")
list_4 = ValueList({"MoveAbsJ": 0, "MoveL": 1, "MoveJ": 2, "MoveC": 3}, selected="MoveJ")
list_5 = ValueList({"v5": 5, "v10": 10, "v20": 20, "v30": 30, "v40": 40, "v50": 50, "v60": 60, "v80": 80, "v100": 100, "v150": 150, "v200": 200, "v300": 300, "v400": 400, "v500": 500, "v600": 600, "v800": 800, "v1000": 1000, "v1500": 1500, "v2000": 2000, "v2500": 2500, "v3000": 3000, "v4000": 4000, "v5000": 5000, "v6000": 6000, "v7000": 7000}, selected="v200")
list_6 = ValueList({"v5": 5, "v10": 10, "v20": 20, "v30": 30, "v40": 40, "v50": 50, "v60": 60, "v80": 80, "v100": 100, "v150": 150, "v200": 200, "v300": 300, "v400": 400, "v500": 500, "v600": 600, "v800": 800, "v1000": 1000, "v1500": 1500, "v2000": 2000, "v2500": 2500, "v3000": 3000, "v4000": 4000, "v5000": 5000, "v6000": 6000, "v7000": 7000}, selected="v200")
merge_4 = Merge(Data1=list, Data2=list_2)
list_7 = ValueList({"z0": 0, "z1": 1, "z5": 5, "z10": 10, "z15": 15, "z20": 20, "z30": 30, "z40": 40, "z50": 50, "z60": 60, "z80": 80, "z100": 100, "z150": 150, "z200": 200, "fine": -1}, selected="z5")
M = Move(
    Type=merge_4,
    Target=rt_2,
    SpeedData=sd,
    ZoneData=list_7,
    WorkObject=wo,
    Override_Robot_Tool=False,
    Override_Work_Object=True,
    Set_Circular_Point=False,
    Set_Digital_Output=False,
    Set_Movement_Time=False)
lcc = LinearConfigurationControl(IsActive=False)
M_2 = Move(
    Type=list_3,
    Target=rt,
    SpeedData=list_5,
    Override_Robot_Tool=False,
    Override_Work_Object=False,
    Set_Circular_Point=False,
    Set_Digital_Output=False,
    Set_Movement_Time=False)
M_3 = Move(
    Type=list_4,
    Target=rt,
    SpeedData=list_6,
    Override_Robot_Tool=False,
    Override_Work_Object=False,
    Set_Circular_Point=False,
    Set_Digital_Output=False,
    Set_Movement_Time=False)
merge_5 = Merge(Data1=lcc, Data3=M_2, Data4=M, Data5=M_3)

rg = RAPIDGenerator(
    Robot=R,
    Action=merge_5,
    Update=button,
    Add_loaddata=False,
    Add_tooldata=False,
    Add_wobjdata=False,
    Module_Name=False,
    Output_loaddata=False,
    Output_tooldata=False,
    Output_wobjdata=False,
    Routine_Name=False)
pg = PathGenerator(
    Robot=R,
    Action=merge_5,
    Interpolations=Slider(50, range=0..100),
    AnimationSlider=Slider(0, range=0..1),
    Update=button,
    Output_Configuration_Data=False,
    Output_Configuration_Datas=False,
    Output_Error_Messages=False,
    Output_External_Axis_Planes=False,
    Output_External_Joint_Position=False,
    Output_External_Joint_Positions=False,
    Output_Movement=False,
    Output_Movements=False,
    Output_Path=True,
    Output_Posed_Meshes=False,
    Output_Program_Time=False,
    Output_Robot_End_Plane=False,
    Output_Robot_End_Planes=False,
    Output_Robot_Joint_Position=False,
    Output_Robot_Joint_Positions=False,
    Preview_Path=True,
    Preview_Posed_Meshes=True)
crv_4 = Curve(pg)
panel_3 = Panel(rg)
